# Grasshopper definition importTree.gh (Grasshopper 0.8.61)

path = FilePath("C:\Users\JHORIKAWA\Desktop\work\Processing Lec\Obuchi Studio II\07 fractal\drawTree2\positions.txt")
file = ReadFile(Path=path, Lines=True)
split = StringSplit(String=file, Separators=",")
split_2 = SplitList(List=split, Index=3)  # -> simplify(ListA), ListB
item = ListItem(List=split_2.ListA, Index=0, Wrap=False)
item_2 = ListItem(List=split_2.ListA, Index=1, Wrap=False)
item_3 = ListItem(List=split_2.ListA, Index=2, Wrap=False)
item_4 = ListItem(List=split_2.ListB, Index=0, Wrap=False)
item_5 = ListItem(List=split_2.ListB, Index=1, Wrap=False)
item_6 = ListItem(List=split_2.ListB, Index=2, Wrap=False)
pt = PointXYZ(XComponent=item, YComponent=item_2, ZComponent=item_3)
pt_2 = PointXYZ(XComponent=item_4, YComponent=item_5, ZComponent=item_6)
panel = Panel(split_2.ListA)
ln = Line(PointA=pt, PointB=pt_2)
